# Grasshopper definition comfortModelTest.gh (Grasshopper 0.9.76)
# plug-ins: Python Interpreter

ladybug = Ladybug_Ladybug()  # -> Vviiiiiiiiiizzz; plug-in component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
ladybug_2 = Ladybug_Ladybug(path_to_ladybug_libs="C:\Users\mackey\Documents\GitHub\ladybug-core")  # -> Vviiiiiiiiiizzz
#   port path_to_ladybug_libs: Optional input for Ladybug default folder. If empty default folder will be set to C:\ladybug or C:\Users\%USERNAME%\AppData\Roaming\Ladybug\
#   port Vviiiiiiiiiizzz: Current Ladybug mood!!!
# ---------- ladybug_2: Python ----------
from scriptcontext import sticky

sticky["lb_lib_path"] = path_to_ladybug_libs
# ---------- end ladybug_2 ----------
pmvcomfortcalculator = Ladybug_PMVComfortCalculator()  # -> readMe, port, PMV, PPD, SET, port_2, comfortableOrNot, reasonDsicomf, percentComf; plug-in component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
number_slider = Slider(20, range=0..100)
psychchart = Ladybug_PsychrometricChart(dryBulbTemperature=number_slider, relativeHumidity=number_slider, runIt=Toggle(False))  # -> readMe, port, totalComfortPercent, totalComfortOrNot, strategyNames, strategyPercentOfTime, strategyOrNot, port_2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; plug-in component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
wetbulbtemp_dewpointtemp = Ladybug_WetBulbTemp()  # -> readMe, wetBulbTemp, dewPointTemp; plug-in component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
