# Grasshopper definition importEPWTest.gh (Grasshopper 0.9.76)
# plug-ins: Python Interpreter

path = FilePath("C:\EnergyPlusV8-3-0\WeatherData\USA_CO_Golden-NREL.724666_TMY3.epw")
ladybug = Ladybug_Ladybug(path_to_ladybug_libs="C:\Users\Administrator\Documents\GitHub\ladybug")  # -> Vviiiiiiiiiizzz
#   port path_to_ladybug_libs: Optional input for Ladybug default folder. If empty default folder will be set to C:\ladybug or C:\Users\%USERNAME%\AppData\Roaming\Ladybug\
#   port Vviiiiiiiiiizzz: Current Ladybug mood!!!
# ---------- ladybug: Python ----------
from scriptcontext import sticky

sticky["lb_lib_path"] = path_to_ladybug_libs
# ---------- end ladybug ----------
importepw = Ladybug_ImportEpw(epwFile=path)  # -> readMe, latitude, location, dryBulbTemperature, dewPointTemperature, relativeHumidity, windDirection, windSpeed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
#   port epwFile: An .epw file path on your system as a string.
# ---------- importepw: Python ----------
import sys
from scriptcontext import sticky

if "lb_lib_path" in sticky:
    sys.path.append(sticky["lb_lib_path"])

try:
    from ladybug.epw import EPW
    from ladybug.wrapper import Wrapper
except ImportError:
    raise ImportError("Failed to import Ladybug libraries.\n" + \
                      "Set-up path to Ladybug libraries in ladybug_ladybug component")

if _epwFile:
    epwData = EPW(_epwFile)
    location = epwData.location
    dryBulbTemperature = epwData.dryBulbTemperature.values(header = True)
    dewPointTemperature = epwData.dewPointTemperature.values(header = True)
    relativeHumidity = epwData.relativeHumidity.values(header = True)
    windDirection = epwData.windDirection.values(header = True)
    windSpeed = epwData.windSpeed.values(header = True)
    directNormalRadiation = epwData.directNormalRadiation.values(header = True)
    diffuseHorizontalRadiation = epwData.diffuseHorizontalRadiation.values(header = True)
    globalHorizontalRadiation = epwData.globalHorizontalRadiation.values(header = True)
    directNormalIlluminance = epwData.directNormalIlluminance.values(header = True)
    diffuseHorizontalIlluminance = epwData.diffuseHorizontalIlluminance.values(header = True)
    globalHorizontalIlluminance = epwData.globalHorizontalIlluminance.values(header = True)
    totalSkyCover = epwData.totalSkyCover.values(header = True)
    liquidPrecipitationDepth = epwData.liquidPrecipitationDepth.values(header = True)
    barometricPressure = epwData.atmosphericStationPressure.values(header = True)
    modelYear = epwData.years.values(header = True)
# ---------- end importepw ----------
python = PythonScript(x=path)  # -> out, a
# ---------- python: Python ----------
from ladybug.epw import EPW
epwData = EPW(x)
print epwData.dryBulbTemperature
# ---------- end python ----------
panel = Panel(python.a)
pmvcomfortcalculator = Ladybug_PMVComfortCalculator(dryBulbTemperature=importepw.dryBulbTemperature, relativeHumidity=importepw.relativeHumidity, runIt=Toggle(True))  # -> readMe, port, predictedMeanVote, percentPeopleDissatisfied, standardEffectiveTemperature, port_2, comfortableOrNot, percentOfTimeComfortable, port_3, balanceTemperature; inputs dryBulbTemperature: list, meanRadiantTemperature: list, windSpeed: list, relativeHumidity: list, metabolicRate: list, clothingLevel: list, comfortPar: list, analysisPeriod: list, runIt: Boolean
#   port dryBulbTemperature: A number representing the dry bulb temperature of the air in degrees Celcius. This input can also accept a list of temperatures representing conditions at different times or the direct output of dryBulbTemperature from the Import EPW component.
# ---------- pmvcomfortcalculator: Python ----------
import sys
from scriptcontext import sticky

if "lb_lib_path" in sticky:
    sys.path.append(sticky["lb_lib_path"])

try:
    from ladybug.comfort.pmv import PMV
    from ladybug.wrapper import Wrapper
except ImportError:
    raise ImportError("Failed to import Ladybug libraries.\n" + \
                      "Set-up path to Ladybug libraries in ladybug_ladybug component")

if _dryBulbTemperature and _relativeHumidity and _runIt:
    airTemp = [10, 12, 15, 18, 19]
    relHumid = [75, 70, 60, 50, 75]
    myPmvComf = PMV(airTemp, [], [], relHumid)
    
    print myPmvComf.pmv
# ---------- end pmvcomfortcalculator ----------
