# Grasshopper definition importEPW_performance_test.gh (Grasshopper 0.9.76)
# plug-ins: Python Interpreter

path = FilePath("C:\EnergyPlusV8-3-0\WeatherData\USA_CO_Golden-NREL.724666_TMY3.epw")
# Cast to string
# Original
# List assignment
importepw = Ladybug_ImportEpw(epwFile=path)  # -> readMe, latitude, location, dryBulbTemperature, dewPointTemperature, relativeHumidity, windDirection, windSpeed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
#   port epwFile: An .epw file path on your system as a string.
# ---------- importepw: Python ----------
import sys
from scriptcontext import sticky

if "lb_lib_path" in sticky:
    sys.path.append(sticky["lb_lib_path"])

try:
    from ladybug.epw import EPW
    from ladybug.wrapper import Wrapper
except ImportError:
    raise ImportError("Failed to import Ladybug libraries.\n" + \
                      "Set-up path to Ladybug libraries in ladybug_ladybug component")

if _epwFile:
    epwData = EPW(_epwFile)
    location = str(epwData.location)
    dryBulbTemperature = list(epwData.dryBulbTemperature.values(header = True))
    dewPointTemperature = list(epwData.dewPointTemperature.values(header = True))
    relativeHumidity = list(epwData.relativeHumidity.values(header = True))
    windDirection = list(epwData.windDirection.values(header = True))
    windSpeed = list(epwData.windSpeed.values(header = True))
    directNormalRadiation = list(epwData.directNormalRadiation.values(header = True))
    diffuseHorizontalRadiation = list(epwData.diffuseHorizontalRadiation.values(header = True))
    globalHorizontalRadiation = list(epwData.globalHorizontalRadiation.values(header = True))
    directNormalIlluminance = list(epwData.directNormalIlluminance.values(header = True))
    diffuseHorizontalIlluminance = list(epwData.diffuseHorizontalIlluminance.values(header = True))
    globalHorizontalIlluminance = list(epwData.globalHorizontalIlluminance.values(header = True))
    totalSkyCover = list(epwData.totalSkyCover.values(header = True))
    liquidPrecipitationDepth = list(epwData.liquidPrecipitationDepth.values(header = True))
    barometricPressure = list(epwData.atmosphericStationPressure.values(header = True))
    modelYear = list(epwData.years.values(header = True))
# ---------- end importepw ----------
importepw_2 = Ladybug_ImportEpw(epwFile=path)  # -> readMe, latitude, location, dryBulbTemperature, dewPointTemperature, relativeHumidity, windDirection, windSpeed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
#   port epwFile: An .epw file path on your system as a string.
# ---------- importepw_2: Python ----------
import sys
from scriptcontext import sticky

if "lb_lib_path" in sticky:
    sys.path.append(sticky["lb_lib_path"])

try:
    from ladybug.epw import EPW
    from ladybug.wrapper import Wrapper
except ImportError:
    raise ImportError("Failed to import Ladybug libraries.\n" + \
                      "Set-up path to Ladybug libraries in ladybug_ladybug component")

if _epwFile:
    epwData = EPW(_epwFile)
    location = epwData.location
    dryBulbTemperature = epwData.dryBulbTemperature.values(header = True)
    dewPointTemperature = epwData.dewPointTemperature.values(header = True)
    relativeHumidity = epwData.relativeHumidity.values(header = True)
    windDirection = epwData.windDirection.values(header = True)
    windSpeed = epwData.windSpeed.values(header = True)
    directNormalRadiation = epwData.directNormalRadiation.values(header = True)
    diffuseHorizontalRadiation = epwData.diffuseHorizontalRadiation.values(header = True)
    globalHorizontalRadiation = epwData.globalHorizontalRadiation.values(header = True)
    directNormalIlluminance = epwData.directNormalIlluminance.values(header = True)
    diffuseHorizontalIlluminance = epwData.diffuseHorizontalIlluminance.values(header = True)
    globalHorizontalIlluminance = epwData.globalHorizontalIlluminance.values(header = True)
    totalSkyCover = epwData.totalSkyCover.values(header = True)
    liquidPrecipitationDepth = epwData.liquidPrecipitationDepth.values(header = True)
    barometricPressure = epwData.atmosphericStationPressure.values(header = True)
    modelYear = epwData.years.values(header = True)
# ---------- end importepw_2 ----------
ladybug = Ladybug_Ladybug(path_to_ladybug_libs="C:\Users\Administrator\Documents\GitHub\ladybug")  # -> Vviiiiiiiiiizzz
#   port path_to_ladybug_libs: Optional input for Ladybug default folder. If empty default folder will be set to C:\ladybug or C:\Users\%USERNAME%\AppData\Roaming\Ladybug\
#   port Vviiiiiiiiiizzz: Current Ladybug mood!!!
# ---------- ladybug: Python ----------
from scriptcontext import sticky

sticky["lb_lib_path"] = path_to_ladybug_libs
# ---------- end ladybug ----------
importepw_3 = Ladybug_ImportEpw(epwFile=path)  # -> readMe, latitude, location, dryBulbTemperature, dewPointTemperature, relativeHumidity, windDirection, windSpeed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
#   port epwFile: An .epw file path on your system as a string.
# ---------- importepw_3: Python ----------
import sys
from scriptcontext import sticky

if "lb_lib_path" in sticky:
    sys.path.append(sticky["lb_lib_path"])

try:
    from ladybug.epw import EPW
    from ladybug.wrapper import Wrapper
except ImportError:
    raise ImportError("Failed to import Ladybug libraries.\n" + \
                      "Set-up path to Ladybug libraries in ladybug_ladybug component")

if _epwFile:
    epwData = EPW(_epwFile)
    location = str(epwData.location)
    dryBulbTemperature = (str(d) for d in epwData.dryBulbTemperature.values(header = True))
    dewPointTemperature = (str(d) for d in epwData.dewPointTemperature.values(header = True))
    relativeHumidity = (str(d) for d in epwData.relativeHumidity.values(header = True))
    windDirection = (str(d) for d in epwData.windDirection.values(header = True))
    windSpeed = (str(d) for d in epwData.windSpeed.values(header = True))
    directNormalRadiation = (str(d) for d in epwData.directNormalRadiation.values(header = True))
    diffuseHorizontalRadiation = (str(d) for d in epwData.diffuseHorizontalRadiation.values(header = True))
    globalHorizontalRadiation = (str(d) for d in epwData.globalHorizontalRadiation.values(header = True))
    directNormalIlluminance = (str(d) for d in epwData.directNormalIlluminance.values(header = True))
    diffuseHorizontalIlluminance = (str(d) for d in epwData.diffuseHorizontalIlluminance.values(header = True))
    globalHorizontalIlluminance = (str(d) for d in epwData.globalHorizontalIlluminance.values(header = True))
    totalSkyCover = (str(d) for d in epwData.totalSkyCover.values(header = True))
    liquidPrecipitationDepth = (str(d) for d in epwData.liquidPrecipitationDepth.values(header = True))
    barometricPressure = (str(d) for d in epwData.atmosphericStationPressure.values(header = True))
    modelYear = (str(d) for d in epwData.years.values(header = True))
# ---------- end importepw_3 ----------
# No output assignment
# Duplicate list
importepw_4 = Ladybug_ImportEpw(epwFile=path)  # -> readMe, latitude, location, dryBulbTemperature, dewPointTemperature, relativeHumidity, windDirection, windSpeed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
#   port epwFile: An .epw file path on your system as a string.
# ---------- importepw_4: Python ----------
import sys
import time
from scriptcontext import sticky

if "lb_lib_path" in sticky:
    sys.path.append(sticky["lb_lib_path"])

try:
    from ladybug.epw import EPW
    from ladybug.wrapper import Wrapper
except ImportError:
    raise ImportError("Failed to import Ladybug libraries.\n" + \
                      "Set-up path to Ladybug libraries in ladybug_ladybug component")

if _epwFile:
    st = time.time()
    epwData = EPW(_epwFile)
    epwData.location
    tmp1 = list(epwData.dryBulbTemperature.values(header = True))
    tmp2 = list(epwData.dewPointTemperature.values(header = True))
    tmp3 = list(epwData.relativeHumidity.values(header = True))
    tmp4 = list(epwData.windDirection.values(header = True))
    tmp5 = list(epwData.windSpeed.values(header = True))
    tmp6 = list(epwData.directNormalRadiation.values(header = True))
    tmp7 = list(epwData.diffuseHorizontalRadiation.values(header = True))
    tmp8 = list(epwData.globalHorizontalRadiation.values(header = True))
    tmp9 = list(epwData.directNormalIlluminance.values(header = True))
    tmp10 = list(epwData.diffuseHorizontalIlluminance.values(header = True))
    tmp11 = list(epwData.globalHorizontalIlluminance.values(header = True))
    tmp12 = list(epwData.totalSkyCover.values(header = True))
    tmp13 = list(epwData.liquidPrecipitationDepth.values(header = True))
    tmp14 = list(epwData.atmosphericStationPressure.values(header = True))
    tmp15 = list(epwData.years.values(header = True))
    print time.time() - st
# ---------- end importepw_4 ----------
# No output
# assignment
importepw_5 = Ladybug_ImportEpw(epwFile=path)  # -> readMe, latitude, location, dryBulbTemperature, dewPointTemperature, relativeHumidity, windDirection, windSpeed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
#   port epwFile: An .epw file path on your system as a string.
# ---------- importepw_5: Python ----------
import sys
import time
from scriptcontext import sticky

if "lb_lib_path" in sticky:
    sys.path.append(sticky["lb_lib_path"])

try:
    from ladybug.epw import EPW
    from ladybug.wrapper import Wrapper
except ImportError:
    raise ImportError("Failed to import Ladybug libraries.\n" + \
                      "Set-up path to Ladybug libraries in ladybug_ladybug component")

if _epwFile:
    st = time.time()
    epwData = EPW(_epwFile)
    epwData.location
    epwData.dryBulbTemperature.values(header = True)
    epwData.dewPointTemperature.values(header = True)
    epwData.relativeHumidity.values(header = True)
    epwData.windDirection.values(header = True)
    epwData.windSpeed.values(header = True)
    epwData.directNormalRadiation.values(header = True)
    epwData.diffuseHorizontalRadiation.values(header = True)
    epwData.globalHorizontalRadiation.values(header = True)
    epwData.directNormalIlluminance.values(header = True)
    epwData.diffuseHorizontalIlluminance.values(header = True)
    epwData.globalHorizontalIlluminance.values(header = True)
    epwData.totalSkyCover.values(header = True)
    epwData.liquidPrecipitationDepth.values(header = True)
    epwData.atmosphericStationPressure.values(header = True)
    epwData.years.values(header = True)
    print time.time() - st
# ---------- end importepw_5 ----------
